# Grasshopper definition GhWord_Sample.gh (Grasshopper 1.0.7)
# plug-ins: GhWord

# ---- group: Inputs
_1_launch_word = BooleanToggle(True)
_2_write_contents = BooleanToggle(True)
_3_read_contents = BooleanToggle(True)

# ----
clear_contents = BooleanToggle(True)

# ---- group: Inputs
panel = Panel("Hello World!")
number_slider = Slider(24, range=0..100)
panel_2 = Panel("Arial")
swatch = ColourSwatch(SwatchColor=RGB(41, 41, 41))
panel_3 = Panel("Lorem ipsum is the best! Lorem ipsum dolor sit amet, consectetur adipiscing elit, sed do eiusmod tempor incididunt ut labore et dolore magna aliqua. Ut enim ad minim veniam, quis nostrud exercitation ullamco laboris nisi ut aliquip ex ea commodo consequat. Duis aute irure dolor in reprehenderit in voluptate velit esse cillum dolore eu fugiat nulla pariatur. Excepteur sint occaecat cupidatat non proident, sunt in culpa qui officia deserunt mollit anim id est laborum.")
number_slider_2 = Slider(10, range=0..100)
panel_4 = Panel("Arial")
swatch_2 = ColourSwatch(SwatchColor=RGB(0, 0, 0))
panel_5 = Panel("AECtech.png")

# ----
series = Series(Start=0, Step=1, Count=10)
multiplication = Multiplication(A=series, B=10)
merge = Merge(Data1=graft(series), Data2=graft(multiplication))  # -> simplify(Result)
c_script = CSharpScript(x=panel_5)  # -> out, A; inputs x: String
# ---------- c_script: C# ----------
    var ghDoc = this.Component.OnPingDocument();

    string directoryPath = System.IO.Path.GetDirectoryName(ghDoc.FilePath);

    A = System.IO.Path.Combine(directoryPath, x);
# ---------- end c_script ----------
wd_tbl = CreateTableContent(Values=merge)
# Basic Sample File
# GhWord | Microsoft Word Interoperability Plugin
# Copyright: 2025 CORE studio | Thornton Tomasetti
# Contact: CORE@ThorntonTomasetti.com
# Website: https://www.aectech.us/
wd_app = WordApplication(Activate=_1_launch_word)
wd_txt = CreateTextContent(Text=panel, Size=number_slider, Family=panel_2, Color=swatch)
wd_txt_2 = CreateTextContent(Text=panel_3, Size=number_slider_2, Family=panel_4, Color=swatch_2)
wd_img = CreateImageContent(Image=c_script.A)
wd_doc = WordDocument(WordApplication=wd_app)
panel_6 = Panel(wd_app)
panel_7 = Panel(wd_doc)
panel_8 = Panel([wd_txt, wd_txt_2, wd_img, wd_tbl])
wd_set = SetDocumentContent(WordDocument=wd_doc, Content=[wd_txt, wd_txt_2, wd_img, wd_tbl], Clear=clear_contents, Activate=_2_write_contents)
wd_get = GetDocumentContent(WordDocument=wd_doc, Activate=_3_read_contents)
panel_9 = Panel(wd_get)
item = ListItem(List=wd_get, Index=0, Wrap=True)  # -> Item, Item1, Item2, Item3
wd_detxt = DeconstructTextContent(TextContent=item.Item)
wd_detxt_2 = DeconstructTextContent(TextContent=item.Item1)
wd_deimg = DeconstructImageContent(ImageContent=item.Item2)
wd_detbl = DeconstructTableContent(ImageContent=item.Item3)
panel_10 = Panel(wd_detxt)
panel_11 = Panel(wd_detxt_2)
panel_12 = Panel(wd_deimg)
panel_13 = Panel(wd_detbl)
panel_14 = Panel(merge)
